# Grasshopper definition Clip1.gh (Grasshopper 1.0.7)

thickness = Slider(2, range=0..10)
radius = Slider(2, range=0..10)
deepness = Slider(12.411, range=0..20)
move_y = Slider(5, range=0..10)
segments = Slider(6, range=0..10)
move_x = Slider(2, range=0..10)
radius_2 = Slider(17, range=0..20)
point = Point(Point(0, 0, 0))
num = Slider(0, range=0..10)
unit_y = UnitY(Factor=move_y)
division = Division(A=thickness, B=move_x)
rectangle = Rectangle(Plane=point, XSize=thickness, YSize=deepness, Radius=radius)  # -> Rectangle, Length
polygon = Polygon(Plane=point, Radius=radius_2, Segments=segments, FilletRadius=0)  # -> Polygon, Length
subtraction = Subtraction(A=num, B=division)
unit_x = UnitX(Factor=subtraction)
move = Move(Geometry=rectangle.Rectangle, Motion=unit_x)  # -> Geometry, Transform
move_2 = Move(Geometry=move.Geometry, Motion=unit_y)  # -> Geometry, Transform
counts = Slider(6, range=0..10)
polar_array = PolarArray(Geometry=move_2.Geometry, Plane=point, Count=counts, Angle=6.283185307)  # -> Geometry, Transform
curve = Curve(polar_array.Geometry)
curve_2 = Curve(polygon.Polygon)
group = Group(Objects=[curve_2, curve])
