# Grasshopper definition Nested 1.gh (Grasshopper 1.0.7)

curve = Curve(<curve referenced from the Rhino model>)
point = Point(Point(0, 0, 0))
offset_curve = OffsetCurve(Curve=curve, Distance=Slider(4, range=0..10), Plane=PlaneXY(0, 0, 0), Corners=1)
offset_curve_2 = OffsetCurve(Curve=curve, Distance=Slider(2, range=0..10), Plane=PlaneXY(0, 0, 0), Corners=1)
polygon = Polygon(Plane=point, Radius=Slider(10, range=0..10), Segments=Slider(6, range=0..10), FilletRadius=Slider(1, range=0..10))  # -> Polygon, Length
group = Group([curve, offset_curve_2, offset_curve])
curve_2 = Curve(polygon.Polygon)
offset_curve_3 = OffsetCurve(Curve=curve_2, Distance=Slider(4, range=0..10), Plane=PlaneXY(0, 0, 0), Corners=1)
offset_curve_4 = OffsetCurve(Curve=curve_2, Distance=Slider(2, range=0..10), Plane=PlaneXY(0, 0, 0), Corners=1)
group_2 = Group([curve_2, offset_curve_4, offset_curve_3])
