# Grasshopper definition lamp.gh (Grasshopper 1.0.7)

petal_radius = Slider(27, range=0..50)
line_length = Slider(43, range=0..50)
line_thickness = Slider(1.4, range=0..10)
point = Point(Point(0, -0.01664812991, 0))
X = Slider(2, range=0..50)
move_the_line = Slider(4, range=0..50)
circle = Circle(Plane=point, Radius=petal_radius)
rectangle = Rectangle(Plane=point, XSize=line_length, YSize=line_thickness, Radius=0)  # -> Rectangle, Length
division = Division(A=petal_radius, B=X)
subtraction = Subtraction(A=division, B=move_the_line)
unit_y = UnitY(Factor=subtraction)
move = Move(Geometry=rectangle.Rectangle, Motion=unit_y)  # -> Geometry, Transform
X_2 = Slider(0, range=0..10)
curve = Curve(move.Geometry)
curve_2 = Curve(circle)
X_3 = Slider(5, range=0..10)
subtraction_2 = Subtraction(A=X_2, B=petal_radius)
unit_y_2 = UnitY(Factor=subtraction_2)
polar_array = PolarArray(Geometry=curve_2, Plane=unit_y_2, Count=X_3, Angle=6.283185307)  # -> Geometry, Transform
polar_array_2 = PolarArray(Geometry=curve, Plane=unit_y_2, Count=X_3, Angle=6.283185307)  # -> Geometry, Transform
group = Group(Objects=polar_array.Geometry)
group_2 = Group(Objects=polar_array_2.Geometry)
